# Grasshopper definition example.gh (Grasshopper 1.0.8)
# plug-ins: IsoVistGH

# ----
# Select the "observation point",
# which moves along a curve
number_slider = Slider(0.532, range=0..1)
crv = Curve(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)

# ----
# Curve to tesselate/segment
crv_2 = Curve(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)

# ----
# Two curves; the first is the overall region,
# while the second one is a void region
crv_3 = Curve([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])

# ----
# Tesselate Curve (if curved)
number_slider_2 = Slider(5, range=1..10)
crvtesselation = CurveTesselation(Curve=crv_2, Divisions=number_slider_2)

# ----
# Get IsoVist region
eval = EvaluateCurve(Curve=reparameterize(crv), Parameter=number_slider)  # -> Point, Tangent, Angle
isovist2d = IsoVist2D(CurveS=crv_3, Point=eval.Point)

# ----
# Visualize IsoVist region
number_slider_3 = Slider(6, range=2..8)
highlightisovist = HighlightIsovist(
    IsoVist=isovist2d,
    SegmentsThickness=number_slider_3,
    HatchScale=Slider(3.78, range=2..5),
    HatchRotation=Slider(30, range=30..180))
